vi "CFO Correction.gvi"   [LabVIEW NXG 5.0.0]
inputs:
  "Input": c128[]
  "Index": i32
  "CFOest (freq)": f64[]
  "fs": f64 = 7680000
outputs:
  "Output": c128[]
uses:
  NI::Analysis::Generation::Ramp Pattern by Samples.gvi
diagram:
  Array Index(array=$"CFOest (freq)") -> (out0[$Index]=w1)
  Negate(x=w1) -> w2
  Decrement(x=256) -> w3
  call "Ramp Pattern by Samples.gvi"(샘플=256, 시작=0, 끝=w3) -> (램프 패턴=w4)
  Reciprocal(x=$fs) -> w5
  Multiply(w4, 6.28318530718, w5, w2) -> w6
  Polar To Complex(r=1, theta=w6) -> (r * e^(i*theta)=w7)
  Multiply($Input, w7) -> w8
  $Output <- w8
