vi "CP Insertion.gvi"   [LabVIEW NXG 5.0.0]
inputs:
  "Input": c128[]
outputs:
  "Output with CP": c128[]
diagram:
  Delete From Array(inArray=$Input, length (1)=64) -> (deleted=w1)
  Build Array(w1, $Input) -> w2
  $"Output with CP" <- w2
