vi "CP Removal.gvi"   [LabVIEW NXG 5.0.0]
inputs:
  "Input": c128[]
  "Indicies": i32
  "i": i32
  "Frame Size": i32
  "CP Size": i32
  "N-Point FFT Size": i32
outputs:
  "Output Without CP": c128[]
diagram:
  Multiply($"Frame Size", $i) -> w1
  Add($Indicies, w1) -> w2
  Add(w2, $"CP Size") -> w3
  Array Subset(array=$Input, index0=w3, length0=$"N-Point FFT Size") -> w4
  $"Output Without CP" <- w4
