vi "Channel Estimation Linear.gvi"   [LabVIEW NXG 5.0.0]
inputs:
  "Ref": c128[]
outputs:
  "Hest": c128[]
diagram:
  Divide(x=[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], y=$Ref) -> w1
  Array Size(array=w1) -> (size(s)=w2)
  Complex To Real And Imaginary(x + iy=w1) -> (x=w3, y=w4)
  s1 = f64[] []  # shift register
  s2 = f64[] []  # shift register
  for (N = w2) (iteration -> i1) {
    Is Equal(x=i1, y=24) -> w5
    case (w5) {
      frame False, Default {
        Array Index(array=w3) -> (out0[i1]=w8)
        Increment(x=i1) -> w9
        Array Index(array=w3) -> (out0[w9]=w10)
        Subtract(x=w10, y=w8) -> w11
        Divide(x=w11, y=6) -> w12
        Multiply(w12, [1, 2, 3, 4, 5]) -> w13
        Add(w13, w8) -> w6
        Array Index(array=w4) -> (out0[i1]=w14)
        Increment(x=i1) -> w15
        Array Index(array=w4) -> (out0[w15]=w16)
        Subtract(x=w16, y=w14) -> w17
        Divide(x=w17, y=6) -> w18
        Multiply(w18, [1, 2, 3, 4, 5]) -> w19
        Add(w19, w14) -> w7
      }
      frame True {
        Real And Imaginary To Complex(x=w3, y=w4) -> w20
        Array Index(array=w20) -> (out0[i1]=w21)
        Initialize Array(element=w21, size=5) -> w22
        Complex To Real And Imaginary(x + iy=w22) -> (x=w6, y=w7)
      }
    }
    Insert Into Array(inArray=s1, new=w6) -> w23
    Insert Into Array(inArray=s2, new=w7) -> w24
    next s1 = w23
    next s2 = w24
  }
  Real And Imaginary To Complex(x=s1, y=s2) -> w25
  $Hest <- w25
