vi "Crop Signal.gvi"   [LabVIEW NXG]
inputs:
  "signal in": c128[] = [-7.60564527299e-06-2.01139580422e-05i, -1.55590887825e-05-3.01727248337e-05i, 5.49414403684e-06+7.72309424114e-06i, -5.70222611962e-05+7.78157544342e-06i, 3.45008203657e-05-2.89446195859e-05i, 1.30382191304e-05-1.04908610026e-06i, -1.34537655006e-05-2.23362437287e-05i, 5.26021922774e-06-1.48506498374e-05i, 5.26299930713e-05-1.35640633873e-05i, -3.80436712505e-06+3.58525525359e-05i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]
  "filter length": i32 = 50
  "threshold": f64 = 0.5
  "extra crop": i32
  "min length": i32
  "iq rate": f64
  "min amplitude": f64 = 0.5
outputs:
  "cropped": c128[]
  "data valid": bool
  "moving average": waveform<f64>
  "from to": f64[]
panel indicators:
  "Waveforms": f64[][]
  "from": i32
  "to": i32
diagram:
  # RE
  # FE
  # from
  Complex To Polar(r * e^(i*theta)=$"signal in") -> (r=w1)
  call "Moving Average.gvi"(signal in=w1, filter length=$"filter length") -> (signal out=w2)
  Reciprocal(x=$"iq rate") -> w3
  Build Waveform Node(Y=w2, dt=w3) -> (output waveform=w4)
  $"moving average" <- w4
  # indices of the beginning and the end
  # of the cropped pulse
  # to
  # data valid
  Array Max And Min(array=w2) -> (max value=w5, min value=w6)
  Is Greater Or Equal(x=w2, y=$"min amplitude") -> w7
  for {
    w8 = each element of w7
    w9 = each element of w2
    Select(s=w8, t=w9, f=w6) -> w11
    append w11 to w10
  }
  Subtract(x=w5, y=w6) -> w12
  Multiply(w12, $threshold) -> w13
  Add(w13, w6) -> w14
  Is Greater(x=w10, y=w14) -> w15
  Array Subset(array=w15, index0=1) -> w16
  Logical And(not w15, w16) -> w17
  Boolean To Integer(Boolean=w17) -> (0, 1=w18)
  To Double Precision Float(number=w18) -> w19
  Multiply(w19, w5) -> w20
  Logical And(w15, not w16) -> w21
  Boolean To Integer(Boolean=w21) -> (0, 1=w22)
  To Double Precision Float(number=w22) -> w23
  Multiply(w23, w5) -> w24
  Build Array(w1, w2, w10, w20, w24) -> w25
  $Waveforms <- w25
  Array Size(array=w1) -> (size(s)=w26)
  s1 = 0  # shift register
  while {
    Search 1D Array(1D array=w17, element=TRUE, start index (0)=s1) -> (index of element=w27)
    Is Less Than 0(x=w27) -> w28
    Subtract(x=w26, y=$"min length") -> w29
    Is Less Or Equal(x=w27, y=w29) -> w30
    Increment(x=w27) -> w31
    Search 1D Array(1D array=w21, element=TRUE, start index (0)=w31) -> (index of element=w32)
    Is Greater Or Equal(x=w32, y=$"min length") -> w33
    Subtract(x=w32, y=w27) -> w34
    Is Greater Or Equal(x=w34, y=$"min length") -> w35
    Logical And(w30, w33, w35) -> w36
    Logical Or(w36, w28) -> w37
    Increment(x=w27) -> w38
    next s1 = w38
    stop if w37
  }
  Add($"extra crop", w27) -> w39
  Subtract(x=w32, y=$"extra crop") -> w40
  Is Greater Or Equal To 0(x=w27) -> w41
  Is Greater Or Equal To 0(x=w32) -> w42
  Logical And(w41, w42) -> w43
  Subtract(x=w40, y=w39) -> w44
  Increment(x=w44) -> w45
  Array Subset(array=$"signal in", index0=w39, length0=w45) -> w46
  case (w43) {
    frame False, Default {
      w47 = -1
      w48 = -1
      w49 = default
    }
    frame True {
      w47 = w40
      w48 = w39
      w49 = w46
    }
  }
  $cropped <- w49
  To Double Precision Float(number=w48) -> w50
  Multiply(w50, w3) -> w51
  To Double Precision Float(number=w47) -> w52
  Multiply(w52, w3) -> w53
  Build Array(w51, w53) -> w54
  $"from to" <- w54
  $from <- w48
  $"data valid" <- w43
  $to <- w47
