vi "Data Reference Interleave.gvi"   [LabVIEW NXG 5.0.0]
inputs:
  "Reference Symbols": c128[]
  "Data Symbols": c128[]
outputs:
  "Interleaved Output": c128[]
diagram:
  Decimate Array(array=$"Data Symbols") -> (out0=w1, out1=w2, out2=w3, out3=w4, out4=w5)
  Interleave Array($"Reference Symbols", w1, w2, w3, w4, w5) -> w6
  $"Interleaved Output" <- w6
