vi "Moving Average.gvi"   [LabVIEW NXG]
inputs:
  "signal in": f64[]
  "filter length": i32 = 100
outputs:
  "signal out": f64[]
diagram:
  Array Size(array=$"signal in") -> (size(s)=w1)
  Subtract(x=w1, y=$"filter length") -> w2
  Increment(x=w2) -> w3
  for (N = w3) (iteration -> i1) {
    Array Subset(array=$"signal in", index0=i1, length0=$"filter length") -> w5
    Add Array Elements(numeric array=w5) -> (sum=w6)
    append w6 to w4
  }
  To Double Precision Float(number=$"filter length") -> w7
  Divide(x=w4, y=w7) -> w8
  $"signal out" <- w8
