vi "Sub-sample Timing Offset.gvi"   [LabVIEW NXG]
inputs:
  "output complex waveform in": cluster{"t0": f64, "dt": f64, "Y": c128[]}
  "Sample Offset": i32
outputs:
  "output complex waveform out": cluster{"t0": f64, "dt": f64, "Y": c128[]}
diagram:
  Property Node(instance in=$"output complex waveform in") -> ("dt"=w1)
  Reciprocal(x=w1) -> w2
  Multiply(w2, 10) -> w3
  call "MT Resample (Complex Cluster).gvi"(input complex waveform=$"output complex waveform in", desired sample rate=w3) -> (output complex waveform=w4)
  Property Node(instance in=w4) -> ("Y"=w5)
  Initialize Array(element=0+0i, size=$"Sample Offset") -> w6
  Build Array[ConcatenateInputs=True](w6, w5, w6) -> w7
  Property Node(instance in=w4, "Y"=w7) -> (instance out=w8)
  call "MT Resample (Complex Cluster).gvi"(input complex waveform=w8, desired sample rate=w2) -> (output complex waveform=w9)
  $"output complex waveform out" <- w9
