vi "VanDeBeek.gvi"   [LabVIEW NXG 5.0.0]
inputs:
  "Input": c128[] = [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]
outputs:
  "Indices": i32[]
  "Magnitude": f64[]
  "Phase": f64[]
  "CFOest (Hz)": f64[]
  "CFOest (rad)": f64[]
diagram:
  Complex Conjugate(x + iy=$Input) -> w1
  Absolute Value(x=$Input) -> w2
  Square(x=w2) -> w3
  Array Size(array=$Input) -> (size(s)=w4)
  Subtract(x=w4, y=320) -> w5
  for (N = w5) (iteration -> i1) {
    Add(i1, 256) -> w8
    Array Subset(array=w3, index0=w8, length0=64) -> w9
    Add Array Elements(numeric array=w9) -> (sum=w10)
    Array Subset(array=w3, index0=i1, length0=64) -> w11
    Add Array Elements(numeric array=w11) -> (sum=w12)
    Add(w12, w10) -> w13
    Array Subset(array=$Input, index0=i1, length0=64) -> w14
    Array Subset(array=w1, index0=w8, length0=64) -> w15
    Multiply(w14, w15) -> w16
    Add Array Elements(numeric array=w16) -> (sum=w17)
    Complex To Polar(r * e^(i*theta)=w17) -> (r=w18, theta=w19)
    Multiply(w18, 2) -> w20
    Subtract(x=w20, y=w13) -> w21
    append w21 to w6
    append w19 to w7
  }
  $Magnitude <- w6
  Divide(x=w5, y=320) -> w22
  Reshape Array(inArray=w6, size=w22, size=320) -> w23
  Reshape Array(inArray=w7, size=w22, size=320) -> w24
  for {
    w25 = each element of w23
    w26 = each element of w24
    Array Max And Min(array=w25) -> (max index(es)=w29)
    Array Index(array=w26) -> (out0[w29]=w30)
    append w29 to w27
    append w30 to w28
  }
  $Indices <- w27
  $"CFOest (rad)" <- w28
  Negate(x=6.28318530718) -> w31
  Divide(x=w28, y=w31) -> w32
  $"CFOest (Hz)" <- w32
  $Phase <- w7
