vi "Zero Pad Removal and Deinterleave.gvi"   [LabVIEW NXG 5.0.0]
inputs:
  "Input": c128[]
outputs:
  "Data": c128[]
  "Ref": c128[]
diagram:
  Array Subset(array=$Input, index0=53, length0=75) -> w1
  Array Subset(array=$Input, index0=129, length0=75) -> w2
  Build Array(w1, w2) -> w3
  Decimate Array(array=w3) -> (out0=w4, out1=w5, out2=w6, out3=w7, out4=w8, out5=w9)
  $Ref <- w4
  Interleave Array(w5, w6, w7, w8, w9) -> w10
  $Data <- w10
