vi "Zero Padding.gvi"   [LabVIEW NXG 5.0.0]
inputs:
  "Array in": c128[]
outputs:
  "Array out": c128[]
diagram:
  Initialize Array(element=0+0i, size=256) -> w1
  Split 1D Array(array=$"Array in", index=75) -> (first subarray=w2, second subarray=w3)
  Replace Array Subset(inArray=w1, index=53, new=w2, index=129, new=w3) -> w4
  $"Array out" <- w4
