vi "LMS-based adaptive equalizer with OFDM_simulation.gvi"   [LabVIEW NXG 5.0.0]
panel controls:
  "Number of Bits": i32 = 6800
  "IQ rate": f64 = 1000
  "TX": bool
  "IQ gain imbalance": f64 = 4
  "Sample Offset": i32 = 6
  "Tab": i32
  "eb/n0": f64 = 30
  "RX": bool
  "M-QAM": T1 = "8-QAM"
  "Channel types": enum{"Rician", "Rayleigh"} = "Rician"
  "탭": i32
  "fading on/off": bool
  "Doppler Spread, Hz": f64 = 1  # The Doppler Spread fd(Hz) controls the time varying impulse response of the mobile radio channel. It characterizes the amount of frequency dispersion experienced by transmission of a pure sinusoidal frequency at fc, so that the received signal will comprise tones from frequencies of fc-fd to fc+fd. The coherence time of the channel and Doppler spread are inversely related to one another.
  "Fading Variance": f64 = 0.955056179775  # Variance (power) of the generated noise.
  "frequency offset (Hz)": f64 = 1
  "quadrature skew (deg)": f64 = 1
panel indicators:
  "IQ imbalance, LMS": f64
  "I/Q imbalance, LS": f64
  "Error Vector Magnitude, LMS": f64
  "Error Vector Magnitude, LS": f64
  "Modulation Error ratio, LMS": f64
  "Modulation Error ratio, LS": f64
  "LMS-based equalized": c128[]
  "Unequalized data": c128[]
  "LS estimation": c128[]
types:
  T1 = enum{"4-QAM", "8-QAM", "16-QAM", "32-QAM", "64-QAM", "128-QAM"}
  T2 = cluster{"Y": c128[], "Original Bitstream": i8[], "dt": f64, "t0": f64}
  T3 = cluster{"Y": c128[], "output bit stream": i8[], "dt": f64, "t0": f64}
  T4 = cluster{"Element 1": bool[], "Element 2": bool[]}
  T5 = cluster{"expected sync location (symbols)": i32, "sync sequence": c128[], "sync location uncertainty (symbols)": i32, "sync indent (symbols)": i32}
  T6 = cluster{"taps per symbol": i32, "delta (training)": f64, "delta (steady state)": f64}
uses:
  NI::Modulation::MT Generate Bits (Galois, PN Order).gvi
  NI::Modulation::MT Generate QAM System Parameters(M).gvi
  NI::Modulation::MT Map Bits to QAM Symbols.gvi
  NI::Analysis::Transforms::Inverse Complex FFT.gvi
  NI::Modulation::MT Apply IQ Impairments.gvi
  NI::Modulation::MT Add AWGN.gvi
  NI::Modulation::MT Rician Fading Profile (Gans).gvi
  NI::Modulation::MT Rayleigh Fading Profile (Gans).gvi
  NI::Modulation::MT Apply Flat Fading Profile.gvi
  NI::Analysis::Transforms::Complex FFT.gvi
  NI::Modulation::MT Map QAM Symbols to Bits.gvi
  NI::Modulation::MT Generate Filter Coefficients.gvi
  NI::Modulation::MT Modulate QAM.gvi
  NI::Modulation::MT Demodulate QAM.gvi
diagram:
  w1 = $"IQ rate"
  Reciprocal(x=w1) -> w2
  Obtain Queue(element data type=T2 {all zero or empty}, max queue size=1, name="IQ_Data_QUEUE") -> (queue out=w3)
  w4 = $"Number of Bits"
  while {
    call "MT Generate Bits (Galois, PN Order).gvi"(reset?=FALSE, total bits=w4) -> (output bit stream=w5, error out=w6)
    call "Enum convertto Int.gvi"(Input M-QAM=$"M-QAM") -> (Output M-QAM=w7)
    call "MT Generate QAM System Parameters(M).gvi"(samples per symbol=16, M-QAM=w7) -> (QAM system parameters=w8)
    Property Node(instance in=w8) -> ("symbol map"=w9)
    call "MT Map Bits to QAM Symbols.gvi"(input bit stream=w5, symbol map=w9, error in=w6) -> (symbols=w10, error out=w11)
    Divide(x=w1, y=8) -> w12
    # w12: the symbol rate
    # w13: sampling freq
    Multiply(w12, 8) -> w13
    Array Size(array=w10) -> (size(s)=w14)
    Divide(x=w14, y=125) -> w15
    Reshape Array(inArray=w10, size=w15, size=125) -> w16
    # w1: Tx IQ Sampling Rate [s/sec]
    s1 = c128[] []  # shift register
    for {
      w17 = each element of w16
      call "Data Reference Interleave.gvi"(Reference Symbols=[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], Data Symbols=w17) -> (Interleaved Output=w18)
      call "Zero Padding.gvi"(Array in=w18) -> (Array out=w19)
      call "Inverse Complex FFT.gvi"(FFT{x}=w19, 이동?=TRUE) -> (x=w20, 에러 출력=w21)
      call "CP Insertion.gvi"(Input=w20) -> (Output with CP=w22)
      Insert Into Array(inArray=s1, new=w22) -> w23
      Property Node(instance in=w21)
      next s1 = w23
    }
    Multiply(s1, 0.5) -> w24
    Array Size(array=w24) -> (size(s)=w25)
    w26 = cluster{"t0": f64, "dt": f64, "Y": c128[]} {"t0"=0, "dt"=1, "Y"=[]}
    Property Node(instance in=w26, "dt"=w2, "Y"=w24) -> (instance out=w27)
    call "MT Apply IQ Impairments.gvi"(frequency offset=$"frequency offset (Hz)", reset?=TRUE, input complex waveform=w27, q dc offset=1, iq gain imbalance=$"IQ gain imbalance", quadrature skew=$"quadrature skew (deg)", i dc offset=1) -> (output complex waveform=w28, error out=w29)
    call "MT Add AWGN.gvi"(reset?=TRUE, input complex waveform=w28, samples per symbol=16, bits per symbol=8, eb/n0=$"eb/n0", error in=w29) -> (output complex waveform=w30, seed out=w31, error out=w32)
    case ($"fading on/off") {
      frame False, Default {
        w33 = w30
      }
      frame True {
        case ($"Channel types") {
          frame "Rician", Default {
            call "MT Rician Fading Profile (Gans).gvi"(fading variance=$"Fading Variance", reset?=TRUE, profile length=w25, sampling frequency=w13, doppler spread=$"Doppler Spread, Hz", seed in=w31, error in=w32) -> (fading profile=w35, error out=w34)
          }
          frame "Rayleigh" {
            call "MT Rayleigh Fading Profile (Gans).gvi"(fading variance=$"Fading Variance", reset?=TRUE, profile length=w25, sampling frequency=w13, doppler spread=$"Doppler Spread, Hz", seed in=w31, error in=w32) -> (fading profile=w35, error out=w34)
          }
        }
        call "MT Apply Flat Fading Profile.gvi"(reset?=TRUE, input complex waveform=w30, fading profile=w35, error in=w34) -> (output complex waveform=w33)
      }
    }
    call "Sub-sample Timing Offset.gvi"(output complex waveform in=w33, Sample Offset=$"Sample Offset") -> (output complex waveform out=w36)
    Property Node(instance in=w36) -> ("Y"=w37, "dt"=w38, "t0"=w39)
    Property Node(instance in=T3 {all zero or empty}, "Y"=w37, "output bit stream"=w5, "dt"=w38, "t0"=w39) -> (instance out=w40)
    Lossy Enqueue Element(element=w40, error in=w11, queue=w3) -> (error out=w41, queue out=w42)
    stop if $TX
  }
  Flush Queue(error in=w41, queue=w42) -> (error out=w43, queue out=w44)
  Release Queue(error in=w43, queue=w44)
  Obtain Queue(element data type=T2 {all zero or empty}, max queue size=1, name="IQ_Data_QUEUE") -> (error out=w45, queue out=w46)
  while {
    Dequeue Element(error in=w45, queue=w46) -> (element=w47, error out=w48, queue out=w49, timed out?=w50)
    case (w50) {
      frame False {
        Property Node(instance in=w47) -> ("Y"=w52, "t0"=w53, "dt"=w54, "Original Bitstream"=w55)
        call "VanDeBeek.gvi"(Input=w52) -> (CFOest (Hz)=w56, Indices=w57)
        Divide(x=w1, y=256) -> w58
        Multiply(w56, w58) -> w59
        Array Size(array=w57) -> (size(s)=w60)
        Decrement(x=w60) -> w61
        s2 = i8[] []  # shift register
        for (N = w61) (iteration -> i1) (after w55) {
          w62 = each element of w57
          call "Enum convertto Int.gvi"(Input M-QAM=$"M-QAM") -> (Output M-QAM=w63)
          call "MT Generate QAM System Parameters(M).gvi"(samples per symbol=16, M-QAM=w63) -> (QAM system parameters=w64)
          Property Node(instance in=w64) -> ("symbol map"=w65, "samples per symbol (16)"=w66, instance out=w67)
          call "CP Removal.gvi"(Frame Size=320, CP Size=64, N-Point FFT Size=256, Input=w52, Indicies=w62, i=i1) -> (Output Without CP=w68)
          call "CFO Correction.gvi"(fs=w1, Input=w68, Index=i1, CFOest (freq)=w59) -> (Output=w69)
          call "Complex FFT.gvi"(x=w69, FFT 크기=256, 이동?=TRUE) -> (FFT{x}=w70)
          call "Zero Pad Removal and Deinterleave.gvi"(Input=w70) -> (Data=w71, Ref=w72)
          call "Channel Estimation Linear.gvi"(Ref=w72) -> (Hest=w73)
          Multiply(w71, w73) -> w74
          call "MT Map QAM Symbols to Bits.gvi"(symbols=w74, symbol map=w65, error in=w48) -> (output bit stream=w75, error out=w51)
          Insert Into Array(inArray=s2, new=w75) -> w76
          $"Unequalized data" <- w71
          $"LS estimation" <- w74
          call "MT Generate Filter Coefficients.gvi"(filter length=8, pulse shaping filter="Root Raised Cos", pulse shaping samples per symbol=w66, matched samples per symbol=w66, filter parameter=0.6, modulation type="QAM") -> (pulse shaping filter coefficients=w77)
          call "MT Modulate QAM.gvi"(reset?=TRUE, flush buffers?=FALSE, input bit stream=w75, QAM system parameters=w67, pulse shaping filter coefficients=w77) -> (output complex waveform=w78, error out=w79)
          call "MT Demodulate QAM.gvi"(reset?=TRUE, input complex waveform=w78, QAM system parameters=w67, matched filter coefficients=w77, synchronization parameters=T5 {all zero or empty}, error in=w79) -> (recovered complex waveform=w80, error out=w81)
          w82 = T6 {"taps per symbol"=8, "delta (training)"=0.01, "delta (steady state)"=0.01}
          call "SUB_LMS-based equalizer.gvi"(LMS parameters=w82, Input signal [cluster]=w80, M-QAM system parameters=w67, User length=16, training [re-use]=w75, Error ?=w81) -> (Output signal [cluster]=w83, equalized symbols=w84)
          call "LMS_Performance.gvi"(output bit stream=w75, 클러스터 출력=w67, Output signal [cluster]=w83) -> (EVM [LMS, %]=w85, IQ imbalance [LMS]=w86, MER [LMS]=w87)
          $"Error Vector Magnitude, LMS" <- w85
          $"IQ imbalance, LMS" <- w86
          $"Modulation Error ratio, LMS" <- w87
          $"LMS-based equalized" <- w84
          w88 = cluster{"t0": f64, "dt": f64, "Y": c128[]} {"t0"=0, "dt"=1, "Y"=[]}
          Property Node(instance in=w88, "t0"=w53, "dt"=w54, "Y"=w74) -> (instance out=w89)
          call "LS_est_Performance.gvi"(output bit stream=w75, 클러스터 출력=w67, 클러스터 출력_2=w89) -> (I/Q imbalance [C/E]=w90, EVM [C/E, %]=w91, MER [C/E]=w92)
          $"I/Q imbalance, LS" <- w90
          $"Error Vector Magnitude, LS" <- w91
          $"Modulation Error ratio, LS" <- w92
          next s2 = w76
        }
      }
      frame True {
        w51 = w48
      }
    }
    stop if $RX
  }
  Flush Queue(error in=w51, queue=w49)
