vi "LMS_Performance.gvi"   [LabVIEW NXG 5.1.0]
inputs:
  "output bit stream": i8[]
  "클러스터 출력": T1
  "Output signal [cluster]": cluster{"t0": f64, "dt": f64, "Y": c128[]} = {"t0"=0, "dt"=1, "Y"=[]}
outputs:
  "EVM [LMS, %]": f64
  "Phase error [LMS]": f64
  "Magnitude error [LMS]": f64
  "IQ imbalance [LMS]": f64
  "MER [LMS]": f64
  "quadrature skew": f64
  "origin offset (dB)": f64
types:
  T1 = cluster{"samples per symbol (16)": i32, "symbol map": c128[]}
uses:
  NI::Modulation::MT Measure QAM Quadrature Impairments.gvi
diagram:
  w1 = cluster{"start index": i32, "width": i32} {"start index"=0, "width"=-1}
  call "MT Measure QAM Quadrature Impairments.gvi"(impairment definition="Axis Shear", reset?=FALSE, recovered complex waveform=$"Output signal [cluster]", input bit stream=$"output bit stream", impairment measurement window=w1, QAM system parameters=$"클러스터 출력") -> (quadrature skew=w2, IQ gain imbalance=w3, phase error=w4, EVM=w5, modulation error ratio=w6, magnitude error=w7, DC offset measurements=w8)
  Property Node(instance in=w7) -> ("RMS measurement (%)"=w9)
  $"Magnitude error [LMS]" <- w9
  Property Node(instance in=w8) -> ("origin offset (dB)"=w10)
  $"origin offset (dB)" <- w10
  $"IQ imbalance [LMS]" <- w3
  Property Node(instance in=w4) -> ("RMS measurement (deg)"=w11)
  $"Phase error [LMS]" <- w11
  Property Node(instance in=w5) -> ("RMS measurement (%)"=w12)
  $"EVM [LMS, %]" <- w12
  $"MER [LMS]" <- w6
  $"quadrature skew" <- w2
