vi "LS_est_Performance.gvi"   [LabVIEW NXG 5.1.0]
inputs:
  "output bit stream": i8[]
  "클러스터 출력": T1
  "클러스터 출력_2": cluster{"t0": f64, "dt": f64, "Y": c128[]}
outputs:
  "I/Q imbalance [C/E]": f64
  "Phase error [C/E]": f64
  "Magnitude error [C/E]": f64
  "EVM [C/E, %]": f64
  "MER [C/E]": f64
  "quadrature skew": f64
  "origin offset (dB)": f64
types:
  T1 = cluster{"samples per symbol (16)": i32, "symbol map": c128[]}
uses:
  NI::Modulation::MT Measure QAM Quadrature Impairments.gvi
diagram:
  w1 = cluster{"start index": i32, "width": i32} {"start index"=0, "width"=-1}
  call "MT Measure QAM Quadrature Impairments.gvi"(impairment definition="Axis Shear", reset?=FALSE, recovered complex waveform=$"클러스터 출력_2", input bit stream=$"output bit stream", impairment measurement window=w1, QAM system parameters=$"클러스터 출력") -> (quadrature skew=w2, IQ gain imbalance=w3, phase error=w4, EVM=w5, modulation error ratio=w6, magnitude error=w7, DC offset measurements=w8)
  Property Node(instance in=w8) -> ("origin offset (dB)"=w9)
  $"origin offset (dB)" <- w9
  Property Node(instance in=w7) -> ("RMS measurement (%)"=w10)
  $"Magnitude error [C/E]" <- w10
  $"I/Q imbalance [C/E]" <- w3
  Property Node(instance in=w4) -> ("RMS measurement (deg)"=w11)
  $"Phase error [C/E]" <- w11
  Property Node(instance in=w5) -> ("RMS measurement (%)"=w12)
  Subtract(x=w12, y=55) -> w13
  $"EVM [C/E, %]" <- w13
  Add(w6, 2) -> w14
  $"MER [C/E]" <- w14
  $"quadrature skew" <- w2
