vi "SUB_LMS-based equalizer.gvi"   [LabVIEW NXG 5.1.0]
inputs:
  "Input signal [cluster]": cluster{"t0": f64, "dt": f64, "Y": c128[]} = {"t0"=0, "dt"=1, "Y"=[]}
  "Error ?": error
  "M-QAM system parameters": T1 = {"samples per symbol (16)"=16, "symbol map"=[]}
  "User length": i32 = 1
  "training [re-use]": i8[]
  "LMS parameters": T2 = {"taps per symbol"=1, "delta (training)"=0.01, "delta (steady state)"=0.01}
outputs:
  "Error cluster": error
  "Output signal [cluster]": cluster{"t0": f64, "dt": f64, "Y": c128[]}
  "Output bit stream": i8[]
  "equalized symbols": c128[]
types:
  T1 = cluster{"samples per symbol (16)": i32, "symbol map": c128[]}
  T2 = cluster{"taps per symbol": i32, "delta (training)": f64, "delta (steady state)": f64}
diagram:
  case ($"Error ?") {
    frame No Error {
      Property Node(instance in=$"M-QAM system parameters") -> ("symbol map"=w5)
      call "sub_Valid.gvi"(input complex waveform=$"Input signal [cluster]", qam system parameters=$"M-QAM system parameters", feedforward equalizer (lms) parameters=$"LMS parameters", equalizer length=$"User length", equalizer specification="Specify length") -> (error out=w6)
      call "sub_M-QAM mapper.gvi"(reset?=TRUE, input bit stream=$"training [re-use]", error in=w6, symbol map=w5) -> (symbols=w7, error out=w8)
      call "sub_keep_reset.gvi"() -> (reset?=w9)
      call "sub_algorithm_1.gvi"(reset?=w9, equalizer taps=$"User length", input complex waveform=$"Input signal [cluster]", qam system parameters=$"M-QAM system parameters", feedforward equalizer (lms) parameters=$"LMS parameters", training symbols=w7, error in=w8, equalizer specification="Specify length") -> (output complex waveform=w2, equalized symbols=w4, error out=w10)
      call "sub_M-QAM demapper.gvi"(symbols in=w4, error in=w10, symbol map=w5) -> (bits out=w3, error out=w11)
      call "sub_error_clustering.gvi"(final error in=w11, initial error in=$"Error ?") -> (error out=w1)
    }
    frame Error {
      w1 = $"Error ?"
      w2 = default
      w3 = default
      w4 = default
    }
  }
  $"equalized symbols" <- w4
  $"Output signal [cluster]" <- w2
  $"Output bit stream" <- w3
  $"Error cluster" <- w1
