vi "sub_Constellation.gvi"   [LabVIEW NXG 5.0.0]
inputs:
  "Samples per Symbol": i32
  "입력_2": cluster{"t0": f64, "dt": f64, "Y": c128[]}
  "입력": cluster{"t0": f64, "dt": f64, "Y": c128[]}
outputs:
  "non filter": T1[]
  "adaptive filter": T1[]
types:
  T1 = cluster{"constellation": f64[], "oversampled data": f64[]}
uses:
  NI::Modulation::MT Format Constellation.gvi
diagram:
  call "FilterCPLX.gvi"(waveform to truncate=$"입력", samples per symbol (16)=$"Samples per Symbol") -> (truncated waveform=w1)
  call "MT Format Constellation.gvi"(waveform=w1, samples per symbol=8, offset=$"Samples per Symbol") -> (constellation graph=w2)
  $"non filter" <- w2
  call "FilterCPLX.gvi"(waveform to truncate=$"입력_2", samples per symbol (16)=$"Samples per Symbol") -> (truncated waveform=w3)
  call "MT Format Constellation.gvi"(waveform=w3, samples per symbol=8, offset=$"Samples per Symbol") -> (constellation graph=w4)
  $"adaptive filter" <- w4
