vi "sub_EVM_MER.gvi"   [LabVIEW NXG 5.0.0]
inputs:
  "입력_3": cluster{"t0": f64, "dt": f64, "Y": c128[]}
  "입력_4": i8[]
  "입력_5": bool
  "입력_6": cluster{"t0": f64, "dt": f64, "Y": c128[]}
  "입력_2": bool
  "Output Bit Stream": i8[]
  "입력": "QAM System Parameters.gtype" = {"samples per symbol (16)"=16, "symbol map"=[]}
  "error out": error
outputs:
  "EVM History": f64[][]
  "MER History": f64[][]
types:
  "QAM System Parameters.gtype" = cluster{"samples per symbol (16)": i32, "symbol map": c128[]}
  T1 = cluster{"start index (symbols)": i32, "width (symbols) (-1: all)": i32}
uses:
  NI::Modulation::MT Measure QAM Quadrature Impairments.gvi
diagram:
  w1 = T1 {"start index (symbols)"=65, "width (symbols) (-1: all)"=-1}
  call "MT Measure QAM Quadrature Impairments.gvi"(impairment definition="Axis Shear", reset?=$"입력_2", recovered complex waveform=$"입력_3", input bit stream=$"입력_4", impairment measurement window=w1, QAM system parameters=$"입력") -> (EVM=w2, modulation error ratio=w3)
  Property Node(instance in=w2) -> ("RMS measurement (%)"=w4)
  w5 = T1 {"start index (symbols)"=65, "width (symbols) (-1: all)"=-1}
  call "MT Measure QAM Quadrature Impairments.gvi"(impairment definition="Axis Shear", reset?=$"입력_5", recovered complex waveform=$"입력_6", input bit stream=$"Output Bit Stream", impairment measurement window=w5, error in=$"error out", QAM system parameters=$"입력") -> (EVM=w6, modulation error ratio=w7)
  Property Node(instance in=w6) -> ("RMS measurement (%)"=w8)
  Build Array(w4, w8) -> w9
  Build Array(w9) -> w10
  $"EVM History" <- w10
  # w3: adaptive equalizer
  # w7: system filter only applied
  Build Array(w3, w7) -> w11
  Build Array(w11) -> w12
  $"MER History" <- w12
