vi "sub_M-QAM demapper.gvi"   [LabVIEW NXG 5.0.0]
inputs:
  "symbols in": c128[]
  "symbol map": c128[]
  "error in": error
outputs:
  "bits out": i8[]
  "error out": error
diagram:
  $"error out" <- $"error in"
  case ($"error in") {
    frame No Error {
      while {
        Array Size(array=$"symbol map") -> (size(s)=w2)
        Logarithm Base 2(x=w2) -> w3
        To Signed 32 Bit Integer(number=w3) -> w4
        Array Size(array=$"symbols in") -> (size(s)=w5)
        Multiply(w5, w4) -> w6
        Initialize Array(element=0, size=w6) -> w7
        s1 = w7  # shift register
        for (iteration -> i1) {
          w8 = each element of $"symbols in"
          Multiply(w4, i1) -> w9
          Subtract(x=w8, y=$"symbol map") -> w10
          Complex To Polar(r * e^(i*theta)=w10) -> (r=w11)
          Array Max And Min(array=w11) -> (min index(es)=w12)
          Number To Boolean Array(number=w12) -> (Boolean array=w13)
          Boolean To 0 Or 1(Boolean=w13) -> (0, 1=w14)
          To Signed 8 Bit Integer(number=w14) -> w15
          Split 1D Array(array=w15, index=w4) -> (first subarray=w16)
          Replace Array Subset(inArray=s1, index=w9, new=w16) -> w17
          Array Index(array=$"symbol map")
          next s1 = w17
        }
        continue if FALSE
      }
      w1 = s1
    }
    frame Error {
      w1 = default
    }
  }
  $"bits out" <- w1
