vi "sub_M-QAM mapper.gvi"   [LabVIEW NXG 5.0.0]
inputs:
  "input bit stream": i8[]
  "error in": error
  "reset?": bool = TRUE
  "symbol map": c128[]
outputs:
  "error out": error
  "symbols": c128[]
diagram:
  $"error out" <- $"error in"
  case ($"error in") {
    frame No Error {
      s1 = uninitialised  # shift register
      while {
        Array Size(array=$"symbol map") -> (size(s)=w2)
        Logarithm Base 2(x=w2) -> w3
        To Signed 32 Bit Integer(number=w3) -> w4
        Build Array(s1, $"input bit stream") -> w5
        Select(s=$"reset?", t=$"input bit stream", f=w5) -> w6
        Array Size(array=w6) -> (size(s)=w7)
        Quotient And Remainder(x=w7, y=w4) -> (floor(x/y)=w8, x-y*floor(x/y)=w9)
        Subtract(x=w7, y=w9) -> w10
        Split 1D Array(array=w6, index=w10) -> (first subarray=w11, second subarray=w12)
        for (N = w8) (iteration -> i1) {
          Multiply(w4, i1) -> w13
          Array Subset(array=w11, index0=w13, length0=w4) -> w14
          Is Not Equal To 0(x=w14) -> w15
          Boolean Array To Number[SignExtensionMode=1](Boolean array=w15) -> (number=w16)
          Array Index(array=$"symbol map") -> (out0[w16]=w17)
          append w17 to w1
        }
        next s1 = w12
        continue if FALSE
      }
    }
    frame Error {
      w1 = default
    }
  }
  $symbols <- w1
