vi "sub_M-QAM transmitter.gvi"   [LabVIEW NXG 5.1.0]
inputs:
  "Symbol Rate[Hz]": f64
  "M-QAM": i32
  "Message": T1 = {"# Guard Bits"=4, "# Sync Bits"=40, "# Message Bits"=1000, "PN sequence order"=9}
  "# Samples per Symbol": i32 = 16
  "error in (no error)": error
  "불리언": bool
outputs:
  "output complex waveform": cluster{"t0": f64, "dt": f64, "Y": c128[]}
  "클러스터 출력": T2
  "출력 스트림": i8[]
types:
  T1 = cluster{"# Guard Bits": i32, "# Sync Bits": i32, "# Message Bits": i32, "PN sequence order": i32}
  "QAM System Parameters.gtype" = cluster{"samples per symbol (16)": i32, "symbol map": c128[]}
  T2 = cluster{"Output Bit Stream": i8[], "# bits per symbol": i32, "Sync (Bits)": i8[], "Sync (Symbols)": c128[], "pulse shaping filter coefficients": f64[], "matched filter coefficients": f64[], "QAM System Parameters": "QAM System Parameters.gtype"}
  T3 = enum{"none", "Raised Cosine", "Root Raised Cos", "Gaussian"}
  T4 = cluster{"TX Filter": T3, "Alpha": f64, "filter length": i32}
uses:
  NI::Modulation::MT Generate Filter Coefficients.gvi
  NI::Modulation::MT Generate QAM System Parameters(M).gvi
  NI::Modulation::MT Generate Bits (Galois, PN Order).gvi
  NI::Modulation::MT Modulate QAM.gvi
diagram:
  Property Node(instance in=$Message) -> ("PN sequence order"=w1, "# Guard Bits"=w2, "# Sync Bits"=w3, "# Message Bits"=w4)
  Is First Call() -> w5
  Logical Or(TRUE, w5) -> w6
  Is First Call() -> w7
  Logical Or(w6, w7) -> w8
  w9 = T4 {"TX Filter"="Raised Cosine", "Alpha"=0.2, "filter length"=4}
  Property Node(instance in=w9) -> ("TX Filter"=w10, "Alpha"=w11, "filter length"=w12)
  To Unsigned 64 Bit Integer(number="QAM") -> w13
  call "MT Generate Filter Coefficients.gvi"(filter length=w12, pulse shaping filter=w10, pulse shaping samples per symbol=$"# Samples per Symbol", matched samples per symbol=$"# Samples per Symbol", filter parameter=w11, error in=$"error in (no error)", modulation type=w13) -> (pulse shaping filter coefficients=w14, matched filter coefficients=w15, error out=w16)
  call "Enum convertto Int.gvi"(Input M-QAM=$"M-QAM") -> (Output M-QAM=w17)
  call "MT Generate QAM System Parameters(M).gvi"(samples per symbol=$"# Samples per Symbol", M-QAM=w17, error in=w16) -> (QAM system parameters=w18, bits per symbol=w19, error out=w20)
  call "MT Generate Bits (Galois, PN Order).gvi"(reset?=w8, total bits=w4, PN sequence order=w1, seed in=-692093454, error in=w20) -> (output bit stream=w21, error out=w22)
  Logical And(w8, $"불리언") -> w23
  call "sub_Convert bit to array.gvi"(가드 비트=w2, 싱크 비트 입력=w3, 출력 비트 스트림=w21, 논리적 AND=w23, 에러=w22) -> (입력=w24, 싱크 비트=w25, 에러 출력=w26)
  Is First Call() -> w27
  Logical Or(w27, w8) -> w28
  call "sub_FIFO of bit.gvi"(블록 길이 (-1)=-1, 입력=w24, 논리적 OR=w28) -> (배열=w29, 입력 스트림=w30)
  Array Size(array=w29)
  $"출력 스트림" <- w30
  Property Node(instance in=w18) -> ("symbol map"=w31)
  call "sub_M-QAM mapper.gvi"(reset?=w6, input bit stream=w25, error in=w26, symbol map=w31) -> (symbols=w32, error out=w33)
  call "MT Modulate QAM.gvi"(reset?=w6, input bit stream=w30, QAM system parameters=w18, symbol rate=$"Symbol Rate[Hz]", pulse shaping filter coefficients=w14, error in=w33) -> (output complex waveform=w34)
  $"output complex waveform" <- w34
  Property Node(instance in=T2 {all zero or empty}, "Output Bit Stream"=w30, "Sync (Bits)"=w25, "Sync (Symbols)"=w32, "pulse shaping filter coefficients"=w14, "matched filter coefficients"=w15, "QAM System Parameters"=w18, "# bits per symbol"=w19) -> (instance out=w35)
  $"클러스터 출력" <- w35
