vi "sub_Merging Para.gvi"   [LabVIEW NXG 5.1.0]
inputs:
  "M-QAM_2": enum{"4", "8", "16", "32", "64", "128", "256"} = "4"
  "Guard Symbols": i32
  "Message Symbols": i32
  "Sync Symbols": i32
  "PN sequence order": i32
outputs:
  "Message": T1
types:
  T1 = cluster{"# Guard Bits": i32, "# Sync Bits": i32, "# Message Bits": i32, "PN sequence order": i32}
diagram:
  To Signed 32 Bit Integer(number=$"M-QAM_2") -> w1
  Add(2, w1) -> w2
  Multiply(w2, $"Guard Symbols") -> w3
  Multiply(w2, $"Sync Symbols") -> w4
  Multiply(w2, $"Message Symbols") -> w5
  w6 = T1 {"# Guard Bits"=31, "# Sync Bits"=2048, "# Message Bits"=128, "PN sequence order"=21}
  Property Node(instance in=w6, "# Guard Bits"=w3, "# Sync Bits"=w4, "# Message Bits"=w5, "PN sequence order"=$"PN sequence order") -> (instance out=w7)
  $Message <- w7
