vi "sub_Valid.gvi"   [LabVIEW NXG 5.0.0]
inputs:
  "equalizer specification": enum{"Specify coefficients", "Specify length"} = "Specify coefficients"
  "input complex waveform": cluster{"t0": f64, "dt": f64, "Y": c128[]}
  "qam system parameters": T2 = {"samples per symbol (16)"=16, "symbol map"=[]}
  "feedforward equalizer (lms) parameters": T1 = {"taps per symbol"=1, "delta (training)"=0.01, "delta (steady state)"=0.01}
  "equalizer length": i32 = 1
outputs:
  "error out": error
panel controls:
  "equalizer coefficients": c128[]
types:
  T1 = cluster{"taps per symbol": i32, "delta (training)": f64, "delta (steady state)": f64}
  T2 = cluster{"samples per symbol (16)": i32, "symbol map": c128[]}
uses:
  NI::Modulation::mod_Validate Complex Waveform.gvi
  NI::Modulation::mod_Validate Samples Per Symbol.gvi
  NI::Modulation::mod_Validate Symbol Map (QAM).gvi
  NI::Modulation::mod_Validate Feedforward equalizer (LMS) prms.gvi
  NI::Modulation::mod_Validate Feedforward equalizer length.gvi
diagram:
  call "mod_Validate Complex Waveform.gvi"(input complex waveform=$"input complex waveform") -> (error?=w1, error out=w2)
  Property Node(instance in=$"qam system parameters") -> ("samples per symbol (16)"=w3, "symbol map"=w4)
  call "mod_Validate Samples Per Symbol.gvi"(samples per symbol=w3) -> (error?=w5, error out=w6)
  call "mod_Validate Symbol Map (QAM).gvi"(symbol map=w4) -> (error?=w7, error out=w8)
  call "mod_Validate Feedforward equalizer (LMS) prms.gvi"(feedforward equalizer (lms) parameters=$"feedforward equalizer (lms) parameters", samples per symbol=w3) -> (error ?=w9, error out=w10)
  call "mod_Validate Feedforward equalizer length.gvi"(equalizer coefficients=$"equalizer coefficients", equalizer length=$"equalizer length", equalizer specification=$"equalizer specification") -> (error ?=w11, error out=w12)
  Build Array(w2, w6, w8, w10, w12) -> w13
  Build Array(w1, w5, w7, w9, w11) -> w14
  Search 1D Array(1D array=w14, element=TRUE) -> (index of element=w15)
  Array Index(array=w13) -> (out0[w15]=w16)
  $"error out" <- w16
